# Grasshopper definition unicamTools2.0.gh (Grasshopper 1.0.7)
# plug-ins: Hops, MetaHopper

location_worksheet_name = Panel("locations")
weather_worksheet_name = Panel("weather_data_1hr")
new_workbook = Panel("DBresults")
relative_path = RelativePath(Path=".\")
run = BooleanToggle(True)
document_info = DocumentInfo(AutoUpdate=invert(False), Recursive=invert(False))  # -> DocumentName, DocumentFilePath, Components, Params, _3rdPartyAssemblies
format = Format(Format="{0}{1}\{2}.gh", Culture=127, Data0=relative_path, Data1="white", Data2="make directory paths")
hops = Hops(
    _Path=format,
    _Enabled=run,
    GhFilePath=relative_path,
    LocationWorksheetName=location_worksheet_name,
    WeatherWorksheetName=weather_worksheet_name,
    DBWorkbook=new_workbook,
    CacheResultsInMemory=False,
    CacheSolveResults=False,
    RemoteDefinitionLocation="C:\Users\ionon\OneDrive - Università di Camerino\Documents\GitHub\unicamTools\white\make directory paths.gh",
    RemoteSolveVersion=(0, 1, 0),
    ShowInput_Enabled=True,
    ShowInput_Path=True,
    SynchronousSolve=False)  # -> LocationPath, Weather_data_1hrPath, DBWorkbook
panel = Panel("white")
format_2 = Format(Format="{0}{1}\{2}.gh", Culture=127, Data0=relative_path, Data1=panel, Data2="check directory consistence py")
hops_2 = Hops(
    _Path=format_2,
    _Enabled=run,
    LocationPath=hops.LocationPath,
    Weather_data_1hrPath=hops.Weather_data_1hrPath,
    CacheResultsInMemory=False,
    CacheSolveResults=False,
    RemoteDefinitionLocation="C:\Users\ionon\OneDrive - Università di Camerino\Documents\GitHub\unicamTools\white\check directory consistence py.gh",
    RemoteSolveVersion=(0, 1, 0),
    ShowInput_Enabled=True,
    ShowInput_Path=True,
    SynchronousSolve=True)  # -> Message, Check
panel_2 = Panel("white")
format_3 = Format(Format="{0}{1}\{2}.gh", Culture=127, Data0=relative_path, Data1=panel_2, Data2="Get cities from coordinates")
hops_3 = Hops(
    _Path=format_3,
    Run=hops_2.Check,
    LocationPath=hops.LocationPath,
    CacheResultsInMemory=False,
    CacheSolveResults=False,
    RemoteDefinitionLocation="C:\Users\ionon\OneDrive - Università di Camerino\Documents\GitHub\unicamTools\white\Get cities from coordinates.gh",
    RemoteSolveVersion=(0, 1, 0),
    ShowInput_Enabled=False,
    ShowInput_Path=True,
    SynchronousSolve=True)  # -> Cities, Loc_id
panel_3 = Panel("white")
format_4 = Format(Format="{0}{1}\{2}.gh", Culture=127, Data0=relative_path, Data1=panel_3, Data2="selected Variable and remove 29-02")
format_5 = Format(Format="{0}{1}\", Culture=127, Data0=relative_path, Data1="white")
hops_4 = Hops(
    _Path=format_4,
    Run=hops_2.Check,
    Weather_data_1hrPath=hops.Weather_data_1hrPath,
    CachePath=format_5,
    Cities=hops_3.Cities,
    Loc_id=hops_3.Loc_id,
    CacheResultsInMemory=False,
    CacheSolveResults=False,
    RemoteDefinitionLocation="C:\Users\ionon\OneDrive - Università di Camerino\Documents\GitHub\unicamTools\white\selected Variable and remove 29-02.gh",
    RemoteSolveVersion=(0, 1, 0),
    ShowInput_Enabled=False,
    ShowInput_Path=True,
    SynchronousSolve=True)  # -> SelectedLabels, SelectedData; disabled
